# Grasshopper definition Example.gh (Grasshopper 1.0.7)
# plug-ins: AdaptivePanelsPlugin

# Elytra AdPanels
panel = Panel("https://climate.onebuilding.org/WMO_Region_6_Europe/ESP_Spain/CT_Catalonia/ESP_CT_Tortosa-Ebre.Obs.082380_TMYx.zip")
downloadepw = LBDownloadWeather(weather_URL=panel)  # -> epw_file, stat_file, ddy_file; plug-in component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
importepw = LBImportEPW(epw_file=downloadepw.epw_file)  # -> location, dry_bulb_temperature, dew_point_temperature, relative_humidity, wind_speed, wind_direction, direct_normal_rad, diffuse_horizontal_rad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; plug-in component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
geometry = Geometry(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)
brep = Brep([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])
skymatrix = LBCumulativeSkyMatrix(location=importepw.location, direct_rad=importepw.direct_normal_rad, diffuse_rad=importepw.diffuse_horizontal_rad)  # -> out, sky_mtx; plug-in component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

# ---- group: Solar Incident
grid_size = Slider(100, range=0..100)
offset_dist = Slider(0.1, range=0..0.1)
incidentradiation = LBIncidentRadiation(
    sky_mtx=skymatrix.sky_mtx,
    geometry=flatten(geometry),
    context=flatten(brep),
    grid_size=grid_size,
    offset_dist=offset_dist,
    run=Toggle(True))  # -> out, points, results, total, mesh, legend, title, int_mtx; plug-in component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

# ---- group: Elytra AdPanels
hinge_side = ValueList({"Top": 1, "Bottom": 2, "Left": 2² - 1, "Right": Sqrt(16)}, selected="Left")
panel_width = Slider(866, range=0..10000)
panel_height = Slider(4980, range=0..10000)
panel_thickness = Slider(17, range=0..1000)
horizontal_spacing = Slider(1000, range=0..1000)
vertical_spacing = Slider(1000, range=0..1000)
material_cost_m² = Slider(33, range=0..100)
boundary_offset = Slider(1000, range=0..1000)
columns = Slider(8, range=0..10)
rows = Slider(3, range=0..100)
openness_control = Slider(44, range=0..100)
adaptive_panels_elytra_adpanels = AdaptivePanelsElytraAdPanels(
    FacadeSurface=geometry,
    PanelWidth=panel_width,
    PanelHeight=panel_height,
    PanelThickness=panel_thickness,
    HorizontalSpacing=horizontal_spacing,
    VerticalSpacing=vertical_spacing,
    BoundaryOffset=boundary_offset,
    Columns=columns,
    Rows=rows,
    SolarRadiation=incidentradiation.results,
    OpennessControl=openness_control,
    HingeSide=hinge_side,
    Material="Glass",
    MaterialCostM²=material_cost_m²)  # -> Panels, PanelFrames, PanelCenters, HingeLocations, OpennessAngles, PanelDimensions, BillOfMaterials, ActuatorForces, PanelBreps
